% Simulink data dictionary g1_data.sldd

RobotJointAction = Simulink.Bus()
  q_des: double[29], Unit="rad"
  qd_des: double[29], Unit="rad/s"
  kp: double[29], Unit="N*m/rad"
  kd: double[29], Unit="N*m/(rad/s)"
  tau_ff: double[29], Unit="N*m"

PlantState = Simulink.Bus()
  sim_time: double, Unit="s"
  base_position_world: double[3], Unit="m"
  base_orientation_wxyz: double[4], Unit="1"
  base_linear_velocity_local: double[3], Unit="m/s"
  base_angular_velocity_local: double[3], Unit="rad/s"
  q: double[29], Unit="rad"
  qd: double[29], Unit="rad/s"

DriveDiagnostics = Simulink.Bus()
  tau_ff: double[29], Unit="N*m"
  tau_p: double[29], Unit="N*m"
  tau_d: double[29], Unit="N*m"
  tau_raw: double[29], Unit="N*m"
  tau_applied: double[29], Unit="N*m"
  tau_saturation_error: double[29], Unit="N*m"
  saturation_flag: boolean[29], Unit="1"

WorldDiagnostics = Simulink.Bus()
  pelvis_position_world: double[3], Unit="m"
  pelvis_R_world: double[3 3], Unit="1"
  pelvis_w_world: double[3], Unit="rad/s"
  pelvis_v_world: double[3], Unit="m/s"

FootContactDiagnostics = Simulink.Bus()
  in_contact: boolean, Unit="1"
  normal_force: double, Unit="N"
  friction_force_world: double[3], Unit="N"
  total_force_world: double[3], Unit="N"
  total_torque_world: double[3], Unit="N*m"
  penetration: double, Unit="m"
  wrench_local: double[6], Unit="1"
  cop_local: double[2], Unit="m"
  cop_valid: boolean, Unit="1"
  point_normal_force: double[4], Unit="N"
  point_penetration: double[4], Unit="m"

ContactDiagnostics = Simulink.Bus()
  Left: Bus: FootContactDiagnostics
  Right: Bus: FootContactDiagnostics

ReferenceObservation = Simulink.Bus()
  tick: uint64
  session: uint64
  epoch: uint64
  raw_backend_time: double
  x: double[58]

LocomotionCommand = Simulink.Bus()
  vx: double
  vy: double
  height: double
  yaw_rate: double

ProcessedCommand = Simulink.Bus()
  tick: uint64
  session: uint64
  epoch: uint64
  time: double
  request: boolean
  reset: boolean
  values: double[4]

TargetTrajectories = Simulink.Bus()
  active_count: uint32
  active_time: double[3]
  active_state: double[58 3]
  active_input: double[35 3]
  generated_time: double[3]
  generated_state: double[58 3]
  generated_input: double[35 3]

GaitSchedule = Simulink.Bus()
  event_count: uint32
  event_times: double[64]
  modes: uint8[65]
  gait_index: uint8
  current_mode: uint8
  terminal_time: double

SwingReference = Simulink.Bus()
  parameters: double[8]
  terrain_height: double
  left_support: boolean
  right_support: boolean

ReferenceGait = Simulink.Bus()
  command: Bus: ProcessedCommand
  target: Bus: TargetTrajectories
  schedule: Bus: GaitSchedule
  swing: Bus: SwingReference

GaitTransitionParameters = [-0.1 0.1 -0.1 0.1 10 10
 0.05 0.3 0.05 0.2 0.05 0.05
 0.25 0.5 0.15 0.35 0.05 0.05
 0.45 0.7 0.3 0.55 0.1 0.1
 0.65 0.9 0.5 0.7 0.2 0.2
 0.8 1.3 0.65 10 0.2 0.2
 1.2 10 0.65 10 0.2 0.2]

g1_action_Ts = 0.002
g1_contact_points = [-0.085 0.025 6.938894e-18; -0.085 -0.025 6.938894e-18; 0.085 0.03 6.938894e-18; 0.085 -0.03 6.938894e-18]
g1_contact_threshold = 1
g1_cop_threshold = 5
g1_critical_velocity = 0.001
g1_damping = 10
g1_drive_Ts = 0.0005
g1_foot_offset = [0.035 0 -0.035]
g1_ground_height = 0
g1_kd = [10; 10; 10; 10; 10; 10; 10; 10; 10; 10; 1; 1; 1; 10; 10; 10; 10; 10; 10; 10; 10; 10; 10; 1; 1; 1; 10; 10; 10]
g1_kp = [1200; 1200; 1200; 1200; 1200; 1200; 1200; 1200; 1200; 1200; 100; 100; 100; 1200; 1200; 1200; 1200; 1200; 1200; 1200; 1200; 1200; 1200; 100; 100; 100; 1200; 1200; 1200]

g1_limits = [-0.87267 0.5236
 -0.2618 0.2618
 -1.0472 2.0944
 -2.5307 2.8798
 -0.5236 2.9671
 -2.7576 2.7576
 -0.087267 2.8798
 -3.0892 2.6704
 -1.5882 2.2515
 -2.618 2.618
 -1.614429558 1.614429558
 -1.972222054 1.972222054
 -1.614429558 1.614429558
 -0.87267 0.5236
 -0.2618 0.2618
 -1.0472 2.0944
 -2.5307 2.8798
 -2.9671 0.5236
 -2.7576 2.7576
 -0.087267 2.8798
 -3.0892 2.6704
 -2.2515 1.5882
 -2.618 2.618
 -1.614429558 1.614429558
 -1.972222054 1.972222054
 -1.614429558 1.614429558
 -0.52 0.52
 -0.52 0.52
 -2.618 2.618]

g1_mpc_to_plant = [0 0 0 0 1 0 0 0 0 0 0 0 0 0 0 0 0 0 0 0 0 0 0
 0 0 0 0 0 1 0 0 0 0 0 0 0 0 0 0 0 0 0 0 0 0 0
 0 0 0 0 0 0 0 0 0 0 0 0 0 0 0 0 0 0 1 0 0 0 0
 1 0 0 0 0 0 0 0 0 0 0 0 0 0 0 0 0 0 0 0 0 0 0
 0 1 0 0 0 0 0 0 0 0 0 0 0 0 0 0 0 0 0 0 0 0 0
 0 0 1 0 0 0 0 0 0 0 0 0 0 0 0 0 0 0 0 0 0 0 0
 0 0 0 1 0 0 0 0 0 0 0 0 0 0 0 0 0 0 0 0 0 0 0
 0 0 0 0 0 0 0 0 0 0 0 0 0 0 0 1 0 0 0 0 0 0 0
 0 0 0 0 0 0 0 0 0 0 0 0 0 0 0 0 1 0 0 0 0 0 0
 0 0 0 0 0 0 0 0 0 0 0 0 0 0 0 0 0 1 0 0 0 0 0
 0 0 0 0 0 0 0 0 0 0 0 0 0 0 0 0 0 0 0 0 0 0 0
 0 0 0 0 0 0 0 0 0 0 0 0 0 0 0 0 0 0 0 0 0 0 0
 0 0 0 0 0 0 0 0 0 0 0 0 0 0 0 0 0 0 0 0 0 0 0
 0 0 0 0 0 0 0 0 0 0 1 0 0 0 0 0 0 0 0 0 0 0 0
 0 0 0 0 0 0 0 0 0 0 0 1 0 0 0 0 0 0 0 0 0 0 0
 0 0 0 0 0 0 0 0 0 0 0 0 0 0 0 0 0 0 0 0 0 0 1
 0 0 0 0 0 0 1 0 0 0 0 0 0 0 0 0 0 0 0 0 0 0 0
 0 0 0 0 0 0 0 1 0 0 0 0 0 0 0 0 0 0 0 0 0 0 0
 0 0 0 0 0 0 0 0 1 0 0 0 0 0 0 0 0 0 0 0 0 0 0
 0 0 0 0 0 0 0 0 0 1 0 0 0 0 0 0 0 0 0 0 0 0 0
 0 0 0 0 0 0 0 0 0 0 0 0 0 0 0 0 0 0 0 1 0 0 0
 0 0 0 0 0 0 0 0 0 0 0 0 0 0 0 0 0 0 0 0 1 0 0
 0 0 0 0 0 0 0 0 0 0 0 0 0 0 0 0 0 0 0 0 0 1 0
 0 0 0 0 0 0 0 0 0 0 0 0 0 0 0 0 0 0 0 0 0 0 0
 0 0 0 0 0 0 0 0 0 0 0 0 0 0 0 0 0 0 0 0 0 0 0
 0 0 0 0 0 0 0 0 0 0 0 0 0 0 0 0 0 0 0 0 0 0 0
 0 0 0 0 0 0 0 0 0 0 0 0 0 0 1 0 0 0 0 0 0 0 0
 0 0 0 0 0 0 0 0 0 0 0 0 0 1 0 0 0 0 0 0 0 0 0
 0 0 0 0 0 0 0 0 0 0 0 0 1 0 0 0 0 0 0 0 0 0 0]

g1_mu_dynamic = 1.2
g1_mu_static = 1.5
g1_normal_d = 1000
g1_normal_k = 100000
g1_stop_d = 100
g1_stop_k = 10000
g1_stop_width = 0.001
g1_tau_max = [50; 50; 25; 88; 88; 88; 139; 25; 25; 25; 5; 25; 5; 50; 50; 25; 88; 88; 88; 139; 25; 25; 25; 5; 25; 5; 50; 50; 88]
g1_transition_width = 0.001